# Grasshopper definition colour-wheel.gh (Grasshopper 1.0.7)

wheel = ColourWheel(
    "3",
    ColourGrips_Style=31,
    ColourGrips_Grip=[4.32381298, 0.1350227751, 2.229417877, 1.182220326],
    ColourGrips_Lum=[0.3385484314, 0.6299360593],
    ColourGrips_Range=[0.2823885374, 0.2823885374, 0.2823885374, 0.2823885374],
    ColourGrips_Sat=[1, 0.5067951531])
legend = Legend(Colour=wheel, Tags=["One Fish", "Two Fish", "Red Fish", "Blue Fish"], LegendType=1)
concat = Concatenate(FragmentA="'rgb(", FragmentB=wheel, FragmentC=")',")
panel = Panel("rgb(68, 51, 255)")
index = ItemIndex(List=concat, Item=concat)
panel_2 = Panel("""}
export default colours""")
concat_2 = Concatenate(FragmentD="'", FragmentA=index, FragmentE="'", FragmentB=" : ", FragmentC=concat)
join = TextJoin(Text=concat_2)
concat_3 = Concatenate(FragmentA="const colours = {", FragmentB=join, FragmentC=panel_2)
panel_3 = Panel(concat_3)
